# Grasshopper definition mobile_robot_workspace_only_ROS.ghx (Grasshopper 1.0.7)

# ---- group: ROS client
disconnect = Button()
connect = Button()
connect_2 = PythonScript(ip="192.168.0.40", connect=connect, disconnect=disconnect)  # -> out, ros_client
# ---------- connect_2: Python ----------
import sys
import scriptcontext as sc
from compas_fab.backends import RosClient

key = 'rosclient_%s' % str(ghenv.Component.InstanceGuid)
previous_client = sc.sticky.get(key, None)

if previous_client and (connect or disconnect):
    previous_client.close()

if connect:
    ros_client = RosClient(ip, 9090)
    sc.sticky[key] = ros_client
    ros_client.run(5)

ros_client = sc.sticky.get(key, None)
print('ROS connected: {}'.format(ros_client.is_connected if ros_client else 'False'))
# ---------- end connect_2 ----------
is_connected = Panel(connect_2.out)

# ----
# Subscribe to topics
toggle = BooleanToggle(True)
subscriber = GhPythonScript(
    ros_client=connect_2.ros_client,
    subscribe_to_robot_lift_topic=toggle,
    subscribe_to_robotnik_base_topic=toggle,
    subscribe_to_static_tf_topic=toggle,
    subscribe_to_battery_data=toggle)  # -> out
# ---------- subscriber: Python ----------
import time
import logging
import datetime
import Grasshopper
from roslibpy import Topic
from scriptcontext import sticky

LOGGER = logging.getLogger('roslibpy')

robot_lift_pos = 'listener_robot_lift_pos'
robot_base_footprint = 'listener_robot_base_footprint'
tf_static = 'listener_tf_static'
robot_battery_data = 'listener_robot_battery_data'

if subscribe_to_robot_lift_topic:
    if ros_client and ros_client.is_connected:
        print("subscribed to /robot/ewellix_driver/lift/pos topic")
        listener = Topic(ros_client, '/robot/ewellix_driver/lift/pos', 'std_msgs/Float64')
        sticky[robot_lift_pos] = listener
    else:
        sticky[robot_lift_pos] = None
        print("NOT subscribed to /robot/ewellix_driver/lift/pos topic")
else:
    sticky[robot_lift_pos] = None

if subscribe_to_robotnik_base_topic:
    if ros_client and ros_client.is_connected:
        print("subscribed to /robot/robotnik_base_control/odom topic")
        listener = Topic(ros_client, '/robot/robotnik_base_control/odom', 'nav_msgs/Odometry')
        sticky[robot_base_footprint] = listener
    else:
        sticky[robot_base_footprint] = None
        print("NOT subscribed to /robot/robotnik_base_control/odom topic")
else:
    sticky[robot_base_footprint] = None

if subscribe_to_static_tf_topic:
    if ros_client and ros_client.is_connected:
        print("subscribed to /tf_static topic")
        listener = Topic(ros_client, '/tf_static', 'tf2_msgs/TFMessage')
        sticky[tf_static] = listener
        #print sticky[tf_static]
    else:
        sticky[tf_static] = None
        print("NOT subscribed to /tf_static topic")
else:
    sticky[tf_static] = None
    
if subscribe_to_battery_data:
    if ros_client and ros_client.is_connected:
        print("subscribed to /robot/battery_estimator/data topic")
        listener = Topic(ros_client, '/robot/battery_estimator/data', '/robotnik_msgs/BatteryStatus')
        sticky[robot_battery_data] = listener
        #print sticky[robot_battery_data]
    else:
        sticky[robot_battery_data] = None
        print("NOT subscribed to /robot/battery_estimator/data topic")
else:
    sticky[robot_battery_data] = None
# ---------- end subscriber ----------
panel = Panel(subscriber)

# ----
# Listen to topics
start_timer = Button()
stop_timer = Button()
bang = Button()
listener = GhPythonScript(bang=bang, start_timer=start_timer, stop_timer=stop_timer)  # -> out, mobile_base_roscf, ur_roscf, robot_map_roscf, lift_pos, robot_map_roscp, mobile_base_roscp, ur_roscp
# ---------- listener: Python ----------
from scriptcontext import sticky
from compas_ghpython.utilities import update_component
from compas.geometry import Frame, Transformation, Translation, Point, Rotation, Vector, Quaternion
from compas_ghpython import draw_frame
import Rhino.Geometry as rg
import math

guid = str(ghenv.Component.InstanceGuid)
timer_running_key = "timer_running_" + guid
counter_key = "counter_" + guid

robot_lift_length = 0.533

if stop_timer or timer_running_key not in sticky:
    sticky[timer_running_key] = False
    sticky[counter_key] = 0

if start_timer:
    sticky[timer_running_key] = True
    sticky[counter_key] = 0
    

if sticky[timer_running_key]:
    update_component(ghenv, 1000)
    
    sticky[counter_key] += 1
    print(sticky[counter_key])


def receive_message_tf_static(message):
    #sticky['message'] = str(datetime.datetime.now()) + ': ' + str(message)
    #print("receiving")
    sticky['ros_msg_tf_static'] = message
    
def receive_message_robot_footprint(message):
    #sticky['message'] = str(datetime.datetime.now()) + ': ' + str(message)
    #print("receiving")
    sticky['ros_msg_robot_footprint'] = message

def receive_message_robot_lift_pos(message):
    #sticky['message'] = str(datetime.datetime.now()) + ': ' + str(message)
    #print("receiving")
    sticky['ros_msg_robot_lift_pos'] = message
    
def receive_message_robot_battery_data(message):
    #sticky['message'] = str(datetime.datetime.now()) + ': ' + str(message)
    #print("receiving")
    sticky['ros_msg_robot_battery_data'] = message


if 'listener_robot_base_footprint' in sticky:
    if sticky['listener_robot_base_footprint']:
    
        listener_robot_base_footprint = sticky['listener_robot_base_footprint']
        listener_robot_base_footprint.subscribe(receive_message_robot_footprint)
    
        if 'ros_msg_robot_footprint' in sticky and sticky['ros_msg_robot_footprint']:
            #bang = True
            
            ros_msg_robot_footprint = sticky['ros_msg_robot_footprint']
            if len(ros_msg_robot_footprint):
                robot_base_footprint = ros_msg_robot_footprint
                p = robot_base_footprint['pose']['pose']
                #print('robot_base_footprint', p)
                mobile_base_roscf = Frame.from_quaternion([p['orientation']['w'],p['orientation']['x'], p['orientation']['y'], p['orientation']['z']], point = [p['position']['x'], p['position']['y'], p['position']['z']])
                mobile_base_roscp = draw_frame(mobile_base_roscf)
                print('++ Listening to ROS MSG ROBOT BASE FOOTPRINT')
                
        else:
            bang = False
            print('NOT receiving ROS MSG ROBOT BASE FOOTPRINT')
    else:
        print('NOT receiving ROS MSG ROBOT BASE FOOTPRINT')


if 'listener_tf_static' in sticky:
    if sticky['listener_tf_static']:
    
        listener_tf_static = sticky['listener_tf_static']
        listener_tf_static.subscribe(receive_message_tf_static)
    
        if 'ros_msg_tf_static' in sticky and sticky['ros_msg_tf_static']:
            #bang = True
            
            ros_msg_tf_static = sticky['ros_msg_tf_static']
            if len(ros_msg_tf_static and ros_msg_tf_static['transforms']):
                
                ### First static transformation from mobile robot base frame to mobile robot base link
                tf0 = ros_msg_tf_static['transforms'][0]
                t0 = tf0['transform']
                #print('robot_base frame to robot_base_link', t0)
                x1, y1, z1 = t0['translation']['x'], t0['translation']['y'], t0['translation']['z']
                
                ## Second static transformation from mobile robot base link to ewellix base link
                tf1 = ros_msg_tf_static['transforms'][2]
                t1 = tf1['transform']
                #print('robot_base_link to ewellix_base_link', t1)
                x2, y2, z2 = t1['translation']['x'], t1['translation']['y'], t1['translation']['z']
                
                print('++ Listening to ROS MSG TF STATIC')

                ## Translations in x, y, z axis from the received static transformations
                T1 = Translation.from_vector(mobile_base_roscf.xaxis*(x1+x2))
                T2 = Translation.from_vector(mobile_base_roscf.yaxis*(y1+y2))
                T3 = Translation.from_vector(mobile_base_roscf.zaxis*(z1+z2))

                T_rbl_ebl = T1*T2*T3
                
                ewellix_base_roscf = mobile_base_roscf.transformed(T_rbl_ebl)
                ewellix_base_roscp = draw_frame(ewellix_base_roscf)
        else:
            bang = False
            print('NOT receiving ROS MSG TF STATIC')
    else:
        print('NOT receiving ROS MSG TF STATIC')


if 'listener_robot_lift_pos' in sticky:
    if sticky['listener_robot_lift_pos']:
    
        listener_robot_lift_pos = sticky['listener_robot_lift_pos']
        listener_robot_lift_pos.subscribe(receive_message_robot_lift_pos)
    
        if 'ros_msg_robot_lift_pos' in sticky and sticky['ros_msg_robot_lift_pos']:
            #bang = True
            
            ros_msg_robot_lift_pos = sticky['ros_msg_robot_lift_pos']
            if len(ros_msg_robot_lift_pos):
                lift_pos = ros_msg_robot_lift_pos['data']
                T_ebl_etl = Transformation.from_frame(Frame.from_quaternion([1.0,0.0,0.0,0.0], point=[0.0,0.0,robot_lift_length + lift_pos]))
                T_static = T_rbl_ebl*T_ebl_etl
                ur_roscf = ewellix_base_roscf.transformed(T_ebl_etl)
                R = Rotation.from_axis_and_angle(ur_roscf.zaxis, math.radians(135), point=ur_roscf.point)
                ur_roscf.transform(R)
                #print(ur_roscf)
                ur_roscp = draw_frame(ur_roscf)
                print('++ Listening to ROS MSG ROBOT LIFT POSITION')
                
        else:
            bang = False
            print('NOT receiving ROS MSG ROBOT LIFT POSITION')
    else:
        print('NOT receiving ROS MSG ROBOT LIFT POSITION')



if 'listener_robot_battery_data' in sticky:
    if sticky['listener_robot_battery_data']:
    
        listener_robot_battery_data = sticky['listener_robot_battery_data']
        listener_robot_battery_data.subscribe(receive_message_robot_battery_data)
    
        if 'ros_msg_robot_battery_data' in sticky and sticky['ros_msg_robot_battery_data']:
            #bang = True
            
            ros_msg_robot_battery_data = sticky['ros_msg_robot_battery_data']
            if len(ros_msg_robot_battery_data):
                robot_battery_data = ros_msg_robot_battery_data

                print('robot_battery_data')

                print('++ Listening to ROS MSG ROBOT BATTERY DATA')
                
        else:
            bang = False
            print('NOT receiving ROS MSG ROBOT BATTERY DATA')
    else:
        print('NOT receiving ROS MSG ROBOT BATTERY DATA')


robot_map_roscf = map_frame= Frame.from_quaternion([0.92596, 0.0, 0.0,-0.37763], point=[4.6994, 4.3827, 0.0])
robot_map_roscp = draw_frame(robot_map_roscf)
# ---------- end listener ----------
panel_2 = Panel(listener.out)
panel_3 = Panel(listener.lift_pos)
draw = GhPythonScript(frames=listener.ur_roscf, scale=Slider(0.1, range=0..1))  # -> P, V, C, W; inputs frames: list
# ---------- draw: Python ----------
from System.Drawing import Color
from compas_ghpython.utilities import draw_frame

red = Color.FromArgb(255, 0, 0)
green = Color.FromArgb(0, 255, 0)
blue = Color.FromArgb(0, 0, 255)

P = []
V = []
C = []

scale = float(scale)

for frame in frames:
    if not frame:
        continue
    plane = draw_frame(frame)
    P += [plane.Origin] * 3
    V.append(plane.XAxis * scale)
    V.append(plane.YAxis * scale)
    V.append(plane.ZAxis * scale)
    C += [red, green, blue]

W = 3
# ---------- end draw ----------
vdisex = VectorDisplayEx(Point=draw.P, Vector=draw.V, Colour=draw.C, Width=draw.W)

mobile_base_roscp = Plane(listener.mobile_base_roscp)
ur_roscp = Plane(listener.ur_roscp)
robot_map_roscp = Plane(listener.robot_map_roscp)

# ----
# 08.02.2022
ros_map = Plane(Plane(origin=(-3.7166, -4.7746, 0), x=(-0.7292837566, 0.6842113726, 0), y=(-0.6842113726, -0.7292837566, 0)))
# 09.02.2022
ros_map_2 = Plane(Plane(origin=(0.33782, 4.6551, 0), x=(0.9992573278, -0.03853300998, 0), y=(0.03853300998, 0.9992573278, 0)))
# 07.02.2022
ros_map_3 = Plane(Plane(origin=(2.5976, 1.7714, 0), x=(0.601898784, -0.7985723848, 0), y=(0.7985723848, 0.601898784, 0)))
# 07.02.2022
ros_map_4 = Plane(Plane(origin=(2.5976, 1.7714, 0), x=(0.601898784, -0.7985723848, 0), y=(0.7985723848, 0.601898784, 0)))
robot_map = Plane(Plane(origin=(-1.01735241, -1.934181884, -0.2004186426), x=(-0.904179102, 0.4271274346, -0.004722945123), y=(-0.4270118644, -0.9041087006, -0.0157583381)))
robot_map_2 = Plane(Plane(origin=(-1.01735241, -1.934181884, -0.2004186426), x=(-0.904179102, 0.4271274346, -0.004722945123), y=(-0.4270118644, -0.9041087006, -0.0157583381)))
robot_map_3 = Plane(Plane(origin=(-1.01735241, -1.934181884, -0.2004186426), x=(-0.904179102, 0.4271274346, -0.004722945123), y=(-0.4270118644, -0.9041087006, -0.0157583381)))
robot_map_4 = Plane(Plane(origin=(-1.01735241, -1.934181884, -0.2004186426), x=(-0.904179102, 0.4271274346, -0.004722945123), y=(-0.4270118644, -0.9041087006, -0.0157583381)))
ur_roscp_2 = Plane(Plane(origin=(-0.8045356093, 2.138311754, 1.086838298), x=(-0.9228522332, 0.3851541973, 0), y=(-0.3851541973, -0.9228522332, 0)))
panel_4 = Panel("""[[   -0.9200,   -0.3917,   -0.0110,    1.1171],
 [    0.3919,   -0.9199,   -0.0122,    2.2159],
 [   -0.0053,   -0.0156,    0.9999,   -0.1262],
 [    0.0000,    0.0000,    0.0000,    1.0000]]""")
panel_5 = Panel("""[[    0.9516,   -0.3072,   -0.0110,    1.0523],
 [    0.3071,    0.9516,   -0.0122,    3.7507],
 [    0.0142,    0.0083,    0.9999,   -0.1081],
 [    0.0000,    0.0000,    0.0000,    1.0000]]""")
panel_6 = Panel("""[[   -0.8852,    0.4650,   -0.0110,    0.4583],
 [   -0.4649,   -0.8853,   -0.0122,    0.8416],
 [   -0.0154,   -0.0057,    0.9999,   -0.1502],
 [    0.0000,    0.0000,    0.0000,    1.0000]]""")
panel_8 = Panel("""[[    0.9993,   -0.0375,   -0.0036,   -0.0159],
 [    0.0375,    0.9993,   -0.0025,   -0.0343],
 [    0.0037,    0.0024,    1.0000,   -0.0004],
 [    0.0000,    0.0000,    0.0000,    1.0000]]""")
panel_9 = Panel("""[[    0.9993,   -0.0370,   -0.0090,    0.0810],
 [    0.0372,    0.9992,    0.0149,    0.0185],
 [    0.0084,   -0.0152,    0.9998,   -0.0030],
 [    0.0000,    0.0000,    0.0000,    1.0000]]""")
panel_10 = Panel("""[[    0.9998,    0.0089,    0.0186,   -0.0219],
 [   -0.0091,    0.9999,    0.0083,    0.0334],
 [   -0.0185,   -0.0085,    0.9998,   -0.0019],
 [    0.0000,    0.0000,    0.0000,    1.0000]]""")
panel_11 = Panel("""[[    1.0000,   -0.0061,    0.0075,   -0.0041],
 [    0.0060,    0.9999,    0.0160,    0.0724],
 [   -0.0076,   -0.0160,    0.9998,    0.0004],
 [    0.0000,    0.0000,    0.0000,    1.0000]]""")

crv = Curve(<curve referenced from the Rhino model>)
pt = Point(<point referenced from the Rhino model>)
crv_2 = Curve(<curve referenced from the Rhino model>)
init_gues = ConstructPlane(Origin=pt, XAxis=crv_2, YAxis=crv)

ur_roscp_3 = Plane(Plane(origin=(-0.01332921089, 0.04300558802, 1.086838298), x=(-0.9772689763, 0.2120031792, 0), y=(-0.2120031792, -0.9772689763, 0)))
init_guess = Plane(Plane(origin=(-0.9669326658, -0.06884816316, 0.9100508767), x=(-0.685351111, 0.7282115083, 0.001361541177), y=(-0.7281299393, -0.6852437459, -0.01636459829)))
init_guess_2 = Plane(Plane(origin=(0.5776833486, -0.9211259235, 0.916508893), x=(-0.1799735024, -0.9835716499, -0.01401242339), y=(0.9836099426, -0.1801032964, 0.008618783048)))
init_guess_3 = Plane(Plane(origin=(1.007828287, -0.08006448112, 0.9315304287), x=(0.6980644493, -0.7160341194, -0.001079074274), y=(0.715950421, 0.6979581131, 0.01641545093)))
ur_base_plane = Plane(Plane(origin=(0.478186, 0.796471, 0.936426), x=(0.9636909338, 0.2666599817, 0.01386499905), y=(-0.2667934872, 0.9637130496, 0.008853995247)))
base_plane_fit = Plane(Plane(origin=(-0.972287, -0.019032, 0.926469), x=(-0.6786879231, 0.7343849168, 0.007841999112), y=(-0.7343886615, -0.6787227994, 0.002941998222)))
base_plane_fit_2 = Plane(Plane(origin=(0.586046, -0.830465, 0.927117), x=(-0.1740749409, -0.9847276658, 0.003055998963), y=(0.9847265004, -0.1740623089, 0.004003999145)))
base_plane_fit_3 = Plane(Plane(origin=(1.082712, -0.010144, 0.938139), x=(0.7240861943, -0.689530185, 0.01572600422), y=(0.689432668, 0.7242533446, 0.01181901455)))

# ----
# Labels
number_slider = Slider(0.1, range=0..1)
pt_2 = Point([Point(0.298708097, 0.5173776006, 0), Point(-0.597416194, 0, 0), Point(0.298708097, -0.5173776006, 0), Point(0.597416194, 0, 0), Point(-0.298708097, 0.5173776006, 0), Point(-0.298708097, -0.5173776006, 0)])
python = GhPythonScript(pts=pt_2)  # -> out, pts, labels; inputs pts: list
# ---------- python: Python ----------
import rhinoscriptsyntax as rs

labels = ['A','B','C','D','E','F']
# ---------- end python ----------
tag = TextTag3D(Location=python.pts, Text=python.labels, Size=number_slider, Colour=RGB(0, 0, 0), Justification=5)

# ----
# T_global
# RosCF to WCF Transformation
# Calculate Basis - Point fitting method via RPC
toggle_2 = BooleanToggle(True)

# ----
# Global Localization
robot_map_5 = Plane(Plane(origin=(-1.01735241, -1.934181884, -0.2004186426), x=(-0.904179102, 0.4271274346, -0.004722945123), y=(-0.4270118644, -0.9041087006, -0.0157583381)))

rcf_to_wcf = GhPythonScript(map_wcp=robot_map_5, map_roscp=robot_map_roscp, calculate=toggle_2)  # -> out, T_roscf_wcf
# ---------- rcf_to_wcf: Python ----------
from compas.geometry import Frame, Transformation
from compas_ghpython import draw_frame
from scriptcontext import sticky

if calculate:
    if map_roscp:
        
        if map_wcp:
            map_wcf = Frame(map_wcp.Origin, map_wcp.XAxis, map_wcp.YAxis)
            map_roscf = Frame(map_roscp.Origin, map_roscp.XAxis, map_roscp.YAxis)
            
            T_roscf_wcf = Transformation.from_frame_to_frame(map_roscf, map_wcf)
            
            sticky['t_global'] = T_roscf_wcf
            
            print('++ RCF received from ROS')
            print(T_roscf_wcf)
        
        else:
            print('++ NO WCF provided')
            sticky['t_global'] = None
        
    else:
        print('++ NOT receiving RCF')
        sticky['t_global'] = None
        
else:
    print('++ LAST TRANSFORMATION')
    
    T_roscf_wcf = sticky['t_global']
# ---------- end rcf_to_wcf ----------
panel_12 = Panel(rcf_to_wcf.out)
t_roscf_wcf = Data(rcf_to_wcf.T_roscf_wcf)

# ----
# Transform UR base to WCF
t_roscf_wcf_2 = Data(t_roscf_wcf)
python_2 = GhPythonScript(T_roscf_wcf=t_roscf_wcf_2, ur_roscf=listener.ur_roscf, mobile_base_roscf=listener.mobile_base_roscf)  # -> out, ur_base_frame, mobile_base_frame, ur_base_plane, mobile_base_plane
# ---------- python_2: Python ----------
import rhinoscriptsyntax as rs
from compas.geometry import Transformation
from compas_ghpython import draw_frame


if ur_roscf:
    ur_base_frame = ur_roscf.transformed(T_roscf_wcf)
    mobile_base_frame = mobile_base_roscf.transformed(T_roscf_wcf)
    
    ur_base_plane = draw_frame(ur_base_frame)
    mobile_base_plane = draw_frame(mobile_base_frame)
    
    print(ur_base_plane)

else:
    print('NO ROS Base Coordinate Frame received')
# ---------- end python_2 ----------
panel_13 = Panel(python_2.out)

mobile_base_plane = Plane(python_2.mobile_base_plane)
ur_base_plane_2 = Plane(python_2.ur_base_plane)

# ----
# Transform
transformations = GhPythonScript(T_global=t_roscf_wcf, ur_roscf=listener.ur_roscf, mobile_base_roscf=listener.mobile_base_roscf)  # -> out, ur_base_plane, mobile_base_plane
# ---------- transformations: Python ----------
import rhinoscriptsyntax as rs
from compas.geometry import Frame, Transformation
from compas_ghpython import draw_frame

#T_global = Transformation.from_matrix([[   -0.9200,   -0.3917,   -0.0110,    1.1171],
# [    0.3919,   -0.9199,   -0.0122,    2.2159],
# [   -0.0053,   -0.0156,    0.9999,   -0.1262],
# [    0.0000,    0.0000,    0.0000,    1.0000]])


#T_local = Transformation.from_matrix([[    0.9993,   -0.0370,   -0.0090,    0.0810],
# [    0.0372,    0.9992,    0.0149,    0.0185],
# [    0.0084,   -0.0152,    0.9998,   -0.0030],
# [    0.0000,    0.0000,    0.0000,    1.0000]])

ur_base_frame = ur_roscf.transformed(T_global)
mobile_base_frame = mobile_base_roscf.transformed(T_global)

if T_local:
    ur_base_frame.transform(T_local)
    mobile_base_frame.transform(T_local)
    
ur_base_plane = draw_frame(ur_base_frame)
print(ur_base_plane)
# ---------- end transformations ----------
panel_14 = Panel(transformations.out)
pln = Plane(transformations.ur_base_plane)

init_guess_4 = Plane(ur_base_plane_2)

# ----
# T_local
base_plane_fit_4 = Plane(Plane(origin=(1.082712, -0.010144, 0.938139), x=(0.7240861943, -0.689530185, 0.01572600422), y=(0.689432668, 0.7242533446, 0.01181901455)))
init_guess_5 = Plane(init_guess_4)
t_local = GhPythonScript(init_guess=init_guess_5, base_plane_fit=base_plane_fit_4)  # -> out, T_local
# ---------- t_local: Python ----------
import rhinoscriptsyntax as rs
from compas.geometry import Transformation, Frame
from compas_ghpython import draw_frame

init_guess_frame = Frame(init_guess.Origin, init_guess.XAxis, init_guess.YAxis)

if base_plane_fit:
    base_frame_fit = Frame(base_plane_fit.Origin, base_plane_fit.XAxis, base_plane_fit.YAxis)
    T_local = Transformation.from_frame_to_frame(init_guess_frame, base_frame_fit)

print(T_local)
# ---------- end t_local ----------

# ----
# T_local
# Local Transformation (relative to workpiece)
# Calculate Basis - Point fitting method via RPC
c_00 = Point([Point(-0.1515, -0.3425511777, 0), Point(-0.0515, -0.3425511777, 0), Point(0.0485, -0.3425511777, 0), Point(0.1485, -0.3425511777, 0), Point(0.220908022, -0.3024784375, 0), Point(0.270908022, -0.2158758971, 0), Point(0.320908022, -0.1292733567, 0), Point(0.370908022, -0.04267081637, 0)])
d_00 = Point([Point(0.270908022, -0.2158758971, 0), Point(0.320908022, -0.1292733567, 0), Point(0.370908022, -0.04267081637, 0), Point(0.372408022, 0.04007274016, 0), Point(0.322408022, 0.1266752805, 0), Point(0.272408022, 0.2132778209, 0)])
e_00 = Point([Point(0.1515, 0.3425511777, 0), Point(0.0515, 0.3425511777, 0), Point(-0.0485, 0.3425511777, 0), Point(-0.1485, 0.3425511777, 0), Point(-0.220908022, 0.3024784375, 0), Point(-0.270908022, 0.2158758971, 0), Point(-0.320908022, 0.1292733567, 0), Point(-0.370908022, 0.04267081637, 0)])
f_00 = Point([Point(-0.372408022, -0.04007274016, 0), Point(-0.322408022, -0.1266752805, 0), Point(-0.272408022, -0.2132778209, 0), Point(-0.222408022, -0.2998803613, 0), Point(-0.1515, -0.3425511777, 0), Point(-0.0515, -0.3425511777, 0), Point(0.0485, -0.3425511777, 0), Point(0.1485, -0.3425511777, 0)])
a_00 = Point([Point(-0.1485, 0.3425511777, 0), Point(-0.0485, 0.3425511777, 0), Point(0.0515, 0.3425511777, 0), Point(0.1515, 0.3425511777, 0), Point(0.222408022, 0.2998803613, 0), Point(0.272408022, 0.2132778209, 0), Point(0.322408022, 0.1266752805, 0), Point(0.372408022, 0.04007274016, 0)])
b_00 = Point([Point(-0.220908022, 0.3024784375, 0), Point(-0.270908022, 0.2158758971, 0), Point(-0.320908022, 0.1292733567, 0), Point(-0.370908022, 0.04267081637, 0), Point(-0.372408022, -0.04007274016, 0), Point(-0.322408022, -0.1266752805, 0), Point(-0.272408022, -0.2132778209, 0), Point(-0.222408022, -0.2998803613, 0)])
calc_base = PythonScript(pts_cad=d_00, base_plane_init_guess=init_guess_4, calc=Toggle(False))  # -> out, pts_mtip_init_guess, pts_mtip_fit, base_plane_fit; inputs poses: list, pts_cad: list of Point3d, base_plane_init_guess: Plane
# ---------- calc_base: Python ----------
import ghpythonlib.components as ghcomp
import Rhino.Geometry as rg
from scriptcontext import sticky as st
from compas.geometry import Frame
import math as m
import sys
from compas.rpc import Proxy # for calling the numpy function in CPython

#poses = [[-0.38248900000000002, -0.65991, -0.92396800000000001, 1.43926, -2.33921, -0.356576], [-0.40332200000000001, -0.561226, -0.92589100000000002, 1.39317, -2.5024600000000001, -0.45355000000000001], [-0.42333500000000002, -0.46363100000000002, -0.92523200000000005, 1.32002, -2.7929300000000001, -0.42181200000000002], [-0.44414100000000001, -0.364207, -0.92577699999999996, -1.1245799999999999, 2.7569599999999999, 0.54737599999999997], [-0.49800100000000003, -0.303369, -0.92580499999999999, -0.97646200000000005, 2.8092899999999998, 0.66510199999999997], [-0.59415899999999999, -0.27221099999999998, -0.92597399999999996, 0.74782499999999996, -2.8146399999999998, -0.69757899999999995], [-0.69017399999999995, -0.24166299999999999, -0.924068, 0.51681200000000005, -2.6232899999999999, -0.79130500000000004], [-0.78496699999999997, -0.21047299999999999, -0.92393599999999998, 0.396513, -2.6047699999999998, -0.78313699999999997]]

if len(poses):
    
    # get points from poses
    pts_mtip = [rg.Point3d(p[0], p[1], p[2]) for p in poses]
    
    T_W_R_init_guess = rg.Transform.PlaneToPlane(rg.Plane.WorldXY, base_plane_init_guess)
    pts_mtip_init_guess = [ghcomp.Transform(pt, T_W_R_init_guess) for pt in pts_mtip]
    
    # format Rhino transformation
    T_W_R_init_guess_flattened = [float(f) for f in T_W_R_init_guess.ToFloatArray(True)]
    T_W_R_init_guess_list = [T_W_R_init_guess_flattened[i:(i + 4)] for i in range(0, len(T_W_R_init_guess_flattened), 4)]  

    # format ptsA and ptsB
    dataB = [list(pt) for pt in pts_cad]
    dataA = [list(pt) for pt in pts_mtip]
    
    # call the function
    max_iterations = 1000
    
    if calc:
        icp_func = Proxy('ur_fabrication_control.optimisation.icp', python = 'C://Users//lidet//anaconda3//envs//learn//python.exe')
        
        print icp_func._python

        transformation, distances = icp_func.icp(dataA, dataB, init_guess=T_W_R_init_guess_list, max_iterations=max_iterations, tolerance=0.000001)
        
        print "distances", distances
        
        # format result
        T = rg.Transform.Identity
        for i in range(4):
            for j in range(4):
                code = "T.M%i%i = %f" % (i, j, transformation[i][j])
                print code
                exec(code)
        #print T
        
        # now transform the points with the transformation calculated
        pts_mtip_fit = [ghcomp.Transform(pt, T) for pt in pts_mtip]
        base_plane_fit = ghcomp.Transform(rg.Plane.WorldXY, T)
        
        
        #f = Frame(base_plane_fit)
        #print f.get_pose_quaternion()
        
        # correct the zvalue
        #base_plane_fit = ghcomp.Transform(base_plane_fit, rg.Transform.Translation(0,0,-3))
# ---------- end calc_base ----------
panel_15 = Panel(calc_base.out)
pt_3 = Point(calc_base.pts_mtip_init_guess)
pt_4 = Point(calc_base.pts_mtip_fit)
pln_2 = Plane(calc_base.base_plane_fit)

# ----
# Local Localization
pln_3 = Plane(transformations.mobile_base_plane)

# ----
# Fabrication Data Record
add = Button()
ur_base_plane_fit = Plane(base_plane_fit_4)
ur_base_plane_3 = Plane(init_guess_5)
ur_roscp_4 = Plane(Plane(origin=(-1.871807435, -4.291410429, 1.086838298), x=(-0.4735157802, -0.8807853348, 0), y=(0.8807853348, -0.4735157802, 0)))
list = ValueList({"A", "B", "C", "D", "E", "F"}, selected="D")
pt_5 = Point(d_00)
python_3 = GhPythonScript(
    segment=list,
    layer=Slider(0, range=0..20),
    pts_cad=pt_5,
    ur_ros_plane=ur_roscp_4,
    ur_rhino_plane=ur_base_plane_3,
    ur_base_measured=ur_base_plane_fit,
    add=add,
    show_record=Toggle(True))  # -> out, point_record; inputs layer: Int32, pts_cad: list
# ---------- python_3: Python ----------
import rhinoscriptsyntax as rs
import os
from compas.geometry import Frame

repositories_path = os.path.abspath(os.path.join(ghdoc.Path,"../../../"))
filepath = os.path.abspath(os.path.join(ghdoc.Path,"../../../mobile_fabrication_control/data/fab_data_record.txt"))

fab_data_record = {}
points_list =[]


segment_id = '{0}{1}{2}'.format(segment, '_0', str(layer))
print segment_id


if pts_cad and ur_ros_plane and ur_rhino_plane and T_global:
    
    for p in pts_cad:
        pt = rs.coerce3dpoint(p)
        points_list.append([pt.X, pt.Y, pt.Z])
    
    fab_data_record['points_cad'] = points_list
    fab_data_record['ur_ros_plane'] = Frame(ur_ros_plane.Origin, ur_ros_plane.XAxis, ur_ros_plane.YAxis)
    fab_data_record['ur_rhino_plane'] = Frame(ur_rhino_plane.Origin, ur_rhino_plane.XAxis, ur_rhino_plane.YAxis)
    fab_data_record['ur_base_measured'] = Frame(ur_base_measured.Origin, ur_base_measured.XAxis, ur_base_measured.YAxis)
    fab_data_record['T_global'] = ''
    fab_data_record['T_local'] = T_local
    fab_data_record['segment_id'] = segment_id
    
    if add:
        f = open(filepath, "a")
        f.write((str(fab_data_record) + "\n" + "\n"))
        f.close()
    
if show_record:
    f = open(filepath, "r")
    point_record=f.read()
# ---------- end python_3 ----------
point_record = Panel(python_3.point_record)
segment_id = Panel(python_3.out)
